# Grasshopper definition kaart.gh (Grasshopper 1.0.7)

geo = Geometry([<point referenced from the Rhino model> x49])
crv = Curve(flatten([<curve referenced from the Rhino model> x4]))
number_slider = Slider(50, range=0..100)
crv_2 = Curve([<curve referenced from the Rhino model> x11])
pt = Point(geo)
number_slider_2 = Slider(10, range=0..10)
range = Range(Domain=Slider(6, range=0..100), Steps=Slider(11, range=0..100))
boundary = BoundarySurfaces(Edges=crv_2)
crv_3 = Curve(<curve referenced from the Rhino model>)
pt_2 = Point(pt)
boundary_2 = BoundarySurfaces(Edges=crv)
pt_3 = ConstructPoint(XCoordinate=0, YCoordinate=0, ZCoordinate=range)
srf = Surface(boundary_2)
patch = Patch(Curves=crv_3, Points=pt_2, Spans=Slider(11, range=0..100), Flexibility=Slider(1000, range=0..1000), Trim=True)
xy = XYPlane(Origin=pt_3)
mesh_uv = MeshSurface(UCount=5, VCount=5, Overhang=True, Equalize=False)
smooth = SettingsQuality()
mesh = MeshBrep(Brep=patch, Settings=smooth)
sec = MeshPlane(Mesh=mesh, Plane=xy)
bang = ExplodeTree(Data=sec)  # -> Branch0, Branch1, Branch2, Branch3, Branch4, Branch5, Branch6, Branch7
crv_4 = Curve(bang.Branch0)
crv_5 = Curve(bang.Branch4)
crv_6 = Curve(bang.Branch1)
crv_7 = Curve(bang.Branch3)
crv_8 = Curve(bang.Branch7)
crv_9 = Curve(bang.Branch2)
crv_10 = Curve(bang.Branch5)
crv_11 = Curve(bang.Branch6)
