# Grasshopper definition super_advanced_script.ghx (Grasshopper 0.9.76)

addition = Addition(A="1000", B="1000")
multiplication = Multiplication(A=addition, B=Slider(4, range=0..10))
addition_2 = Addition(A=multiplication, B="1000")
subtraction = Subtraction(A=addition_2, B="3000")
panel = Panel(subtraction)
